# Dynamo graph Squeeze_cake_v3(переменный слой_не заверш.).dyn "Squeeze_cake_v3(переменный слой)" (Dynamo 2.4.1.6394)
# packages: Civil3DToolkit 1.1.30

code_block = CodeBlock {  }

# group: ВВОД
file_path = Filename("..\..\Школа\Пирог.xlsx")  # graph input
лист_в_excel = StringInput("Тип1")  # graph input
выбери_поверхность = SurfaceNamesDropDown("откос1")  # graph input

# group: вырезать поверхности из замкнутых полилиний с заданными характеристиками из спец шаблона
string = StringInput("Polyline")
current = Autodesk.AutoCAD.DynamoNodes.Document.Current()
modelSpace = Autodesk.AutoCAD.DynamoNodes.Document.ModelSpace(document=current)
all_objects_of_type = AcObjectsOfType(type=string, block=modelSpace)
geometry = Autodesk.AutoCAD.DynamoNodes.Object.Geometry(object=all_objects_of_type)
string_2 = StringInput("Тип покрытия")
propertySetDefinitionByName = Autodesk.AutoCAD.DynamoNodes.Document.PropertySetDefinitionByName(document=current, name=string_2)
propertySetByDefiniton = Autodesk.AutoCAD.DynamoNodes.Object.PropertySetByDefiniton(object=all_objects_of_type, psd=propertySetDefinitionByName)
code_block_2 = CodeBlock { "Тип_покрытия"; ""; }
propertyByName = Autodesk.AutoCAD.DynamoNodes.PropertySet.PropertyByName(propertySet=propertySetByDefiniton, name=code_block_2.out0)
value = Autodesk.AutoCAD.DynamoNodes.Property.Value(property=propertyByName)
number = DoubleInput(1)
count = List.Count(list=value)
range = Range(start=number, end=count)
code_block_3 = CodeBlock(a=value, b=range) { a+"_"+b; }
name = Autodesk.AutoCAD.DynamoNodes.PropertySetDefinition.Name(propertySetDefinition=propertySetDefinitionByName)
value_operators = ValueOperators("Содержит")
filterByProperty = Autodesk.AutoCAD.DynamoNodes.Object.FilterByProperty(objects=all_objects_of_type, propertySetName=name, propertyName=code_block_2.out0, propertyValue=code_block_2.out1, valueOperator=value_operators)
number_2 = DoubleInput(-0.01)

file_from_path = FileObject(path=file_path)
boolean = BoolSelector(false)
importExcel = Data.ImportExcel(file=file_from_path, sheetName=лист_в_excel, readAsStrings=boolean)
deconstruct = List.Deconstruct(list=importExcel)
transpose = List.Transpose(lists=deconstruct.rest)
number_3 = DoubleInput(2)
# note: Толщина слоев
getItemAtIndex = List.GetItemAtIndex(list=transpose, index=number_3)

# group: вычисление смещения
add = _ + _  # unwired: x, y
toNumber = String.ToNumber(str=getItemAtIndex)
byOrigin = CoordinateSystem.ByOrigin()
ZAxis = Vector.ZAxis()
# note: Унарный минус
code_block_4 = CodeBlock { 0; }

number_4 = DoubleInput(0)
eq = toNumber == number_4
filterByBoolMask = List.FilterByBoolMask(list=toNumber, mask=eq)
scan = ScanList(reductor=add, seed=filterByBoolMask.in)  # "List.Scan"; unwired: list1

# group (continued): вычисление смещения
code_block_5 = CodeBlock(a=filterByBoolMask.out) { a*-1; }
# note: Начало координат
# note: Смещение от начала координат
scan_2 = ScanList(reductor=add, seed=code_block_4, list1=code_block_5)  # "List.Scan"
# note: Смещение от предыдущего значения
translate = CoordinateSystem.Translate(coordinateSystem=byOrigin, direction=ZAxis, distance=scan_2)

code_block_6 = CodeBlock(x=translate) { x[-1]; }
code_block_7 = CodeBlock { 0; }
translate_2 = CoordinateSystem.Translate(coordinateSystem=code_block_6, direction=ZAxis, distance=code_block_7)
byCartesianCoordinates = Point.ByCartesianCoordinates(cs=translate_2)
Z = Point.Z(point=byCartesianCoordinates)
python_script = Python(IN[0]=all_objects_of_type)
# ---------- python_script.python (108 lines) ----------
"""
Copyright 2019 Autodesk, Inc. All rights reserved.

This file is part of the Civil 3D Python Module.

"""


import clr

# Add Assemblies for AutoCAD and Civil 3D APIs
clr.AddReference('acmgd')
clr.AddReference('acdbmgd')
clr.AddReference('accoremgd')
clr.AddReference('AecBaseMgd')
clr.AddReference('AecPropDataMgd')
clr.AddReference('AeccDbMgd')
clr.AddReference('AeccPressurePipesMgd')
clr.AddReference('acdbmgdbrep')
clr.AddReference('System.Windows.Forms')
clr.AddReference('ProtoGeometry')

# Add standard Python references
import sys
sys.path.append('C:\Program Files (x86)\IronPython 2.7\Lib')
import os
import math

# Add references to manage arrays, collections and interact with the user
from System import *
from System.IO import *
from System.Collections.Specialized import *
from System.Windows.Forms import MessageBox

# Create an alias to the Autodesk.AutoCAD.ApplicationServices.Application class
import Autodesk.AutoCAD.ApplicationServices.Application as acapp

# Import references from AutoCAD
from Autodesk.AutoCAD.Runtime import *
from Autodesk.AutoCAD.ApplicationServices import *
from Autodesk.AutoCAD.EditorInput import *
from Autodesk.AutoCAD.DatabaseServices import *
from Autodesk.AutoCAD.Geometry import *

# Import references for PropertySets
from Autodesk.Aec.PropertyData import *
from Autodesk.Aec.PropertyData.DatabaseServices import *

# Import references for Civil 3D
from Autodesk.Civil.ApplicationServices import *
from Autodesk.Civil.DatabaseServices import *

import Autodesk.DesignScript.Geometry.Point as DSPoint
import Autodesk.DesignScript.Geometry.PolyCurve as DSPolyCurve

adoc = acapp.DocumentManager.MdiActiveDocument
ed = adoc.Editor

__author__ = 'Paolo Emilio Serra - paolo.serra@autodesk.com'
__copyright__ = '2019'
__version__ = '1.0.0'

# Example function
def my_function(dyn):
	"""
	Description....
	:param first_param: ....
	:returns: ....
	"""
		
	global adoc
	
	output = []
	pc = None

	with adoc.LockDocument():
		with adoc.Database as db:
			with db.TransactionManager.StartTransaction() as t:
				bt = t.GetObject(db.BlockTableId, OpenMode.ForWrite)
				btr = t.GetObject(bt[BlockTableRecord.ModelSpace], OpenMode.ForWrite)
				
				obj = dyn.InternalDBObject  #t.GetObject(dyn.InternalDBObject.ObjectId, OpenMode.ForRead)
				
				for i in range(obj.NumberOfVertices):
					v = obj.GetPoint3dAt(i)
					output.append(DSPoint.ByCoordinates(v.X, v.Y, v.Z))
				
				pc = DSPolyCurve.ByPoints(DSPoint.PruneDuplicates(output), True)
				
				t.Commit()
	return pc
	
	
def ProcessList(_func, _list):
    return list(map(lambda x: ProcessList(_func, x) if type(x)==list else _func(x), _list ))

def tolist(obj):
    if not isinstance(obj, list):
        return [obj]
    else:
        return obj

_result = ProcessList(my_function, tolist(IN[0]))

if len(_result ) == 1 and not isinstance(IN[0],list):
    _result  = _result[0]

OUT = _result
# ----------------------------------------

# group (continued): вырезать поверхности из замкнутых полилиний с заданными характеристиками из спец шаблона
offset = Curve.Offset(curve=python_script, distance=number_2)
startPoint = Curve.StartPoint(curve=offset)
crop = Autodesk.Civil.DynamoNodes.TinSurfaceExtensions.Crop(surface=выбери_поверхность, newName=code_block_3, croppingObjects=filterByProperty, keepLocation=startPoint)  # graph output

flatten = List.Flatten(list=crop)
count_2 = List.Count(list=flatten)
ofRepeatedItem = List.OfRepeatedItem(item=flatten, amount=count_2)
number_5 = DoubleInput(0)
# note: ТИП покрытия
getItemAtIndex_2 = List.GetItemAtIndex(list=transpose, index=number_5)
number_6 = DoubleInput(1)
# note: Материал слоев
getItemAtIndex_3 = List.GetItemAtIndex(list=transpose, index=number_6)

# group: Работа со слоями
раздел = StringInput("_01_ГП_ПП_")
# note: Конкатинация названия слоя.
# Делит по принципу Раздел_ТИП_материал_тольщина
code_block_8 = CodeBlock(d=раздел, a=getItemAtIndex_2, b=getItemAtIndex_3, c=getItemAtIndex) { d+a+'_'+b+'_'+c; z; }  # unwired: z

# note: Преобразует поверхность в тело
createSolids = Autodesk.Civil.DynamoNodes.TinSurfaceExtensions.CreateSolids(surface=ofRepeatedItem, depth=code_block_5, layer=code_block_8.out0)  # graph output
transform = Autodesk.AutoCAD.DynamoNodes.Object.Transform(object=createSolids, coordinateSystem=translate)
geometry_2 = Autodesk.AutoCAD.DynamoNodes.Object.Geometry(object=transform)
code_block_9 = CodeBlock { -1; }
code_block_10 = CodeBlock {  }
difference = Surface.Difference()  # unwired: surface, others
differenceAll = Solid.DifferenceAll()  # unwired: solid, others
sum = Math.Sum(values=filterByBoolMask.out)
createSolids_2 = Autodesk.Civil.DynamoNodes.TinSurfaceExtensions.CreateSolids(surface=flatten, depth=sum)  # graph output
transform_2 = Autodesk.AutoCAD.DynamoNodes.Object.Transform(object=createSolids_2, coordinateSystem=translate_2)
geometry_3 = Autodesk.AutoCAD.DynamoNodes.Object.Geometry(object=transform_2)
выбери_поверхность_2 = SurfaceNamesDropDown("черная")  # graph input
# note: Привет будущий я, тебе нужно найти разность высоты между последним пирогом и нижней поверхностью, надеюсь ты хорошо отдохнул. целую люблю.
createSolidsAtSurface = Autodesk.Civil.DynamoNodes.TinSurfaceExtensions.CreateSolidsAtSurface(surface=flatten, bottomSurface=выбери_поверхность_2)
geometry_4 = Autodesk.AutoCAD.DynamoNodes.Object.Geometry(object=createSolidsAtSurface)
difference_2 = Solid.Difference(solid=geometry_3, other=geometry_4)
byPointsFaceIndices = Mesh.ByPointsFaceIndices()  # unwired: vertexPositions, indices
code_block_11 = CodeBlock {  }
